# Grasshopper definition Planets.gh (Grasshopper 1.0.7)
# plug-ins: Kangaroo2 Components

pt = ConstructPoint(XCoordinate=Slider(2015, range=500..5000), YCoordinate=0, ZCoordinate=0)
pt_2 = ConstructPoint(XCoordinate=0, YCoordinate=0, ZCoordinate=0)
genes = GenePool(Decimals=2, Maximum=1, Minimum=0, Value=[0.13, 0.27, 0.5, 0.76, 1])
ln = Line(StartPoint=pt_2, EndPoint=pt)
shatter = Shatter(Curve=reparameterize(ln), Parameters=genes)
end = EndPoints(Curve=shatter)  # -> Start, End
genes_2 = GenePool(Decimals=0, Maximum=100, Minimum=0, Value=[100, 14, 29, 86, 50, 62])
duppt = RemoveDuplicatePts(Points=[end.Start, end.End], Tolerance=0.01)
sph = Sphere(Base=duppt, Radius=genes_2)
